# Grasshopper definition Example 2a - Analysing a model.gh (Grasshopper 1.0.8)
# plug-ins: FEM-Design

struxml_or_str_file = FilePath()

# ----
# Example 2: Analysing a model
# This example will show you how to automatically run an analysis
# in FEM-Design from within the Grasshopper script.
info = Info(versionWhenCreated="23.2.0")

# ----
# 3. Open FEM-Design connection
# The connection establish a live link comunication with the main software.
# A FEM-Design instance will open for every connection that you create
fem_design_connection = FEMDesignConnection(FEMDesignDir="C:\\Program Files\\StruSoft\\FEM-Design 24\\", Minimized=False, DeleteOutputFolder=False)

# ----
# 4. Analysis settings
# Select the analyses you want to run using
# a simple "true" statement. These settings
# are the same as the ones you'd see if you
# ran the analysis in the FEM-Design interface.
comb_define = CombDefine(
    NLEmaxiter=30,
    PLdefloadstep=20,
    PLminloadstep=2,
    PlKeepLoadStep=True,
    PlTolerance=1,
    Plmaxeqiter=50,
    PlShellLayers=10,
    NLSMohr=True,
    NLSinitloadstep=10,
    NLSminloadstep=10,
    NLSactiveelemratio=5,
    NLSplasticelemratio=5,
    CRloadstep=20,
    CRmaxiter=30,
    CRstifferror=2)
toggle = BooleanToggle(True)
analysis_define = AnalysisDefine(
    Comb=comb_define,
    CalcCase=toggle,
    CalcComb=toggle,
    CalcGmax=False,
    CalcDesign=False,
    Elemfine=True,
    Diaphragm=0,
    PeakSmoothing=False)

fem_design_openmodel = FEMDesignOpenModel(Connection=fem_design_connection, Model=struxml_or_str_file)  # -> Connection, Model, Success, Log

# ----
# 5. Run the analysis
fem_design_runanalysis = FEMDesignRunAnalysis(Connection=fem_design_openmodel.Connection, Analysis=analysis_define)  # -> Connection, Success, Log
