# Grasshopper definition Example 3 - Setup for advanced calculations.gh (Grasshopper 1.0.8)
# plug-ins: FEM-Design

side_wall_base_1 = Curve(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)
side_wall_base_2 = Curve(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)
back_wall_base = Curve(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)
# Base geometry
pillar_base_2 = Point(Point(7, 0, 0))
pillar_base_3 = Point(Point(14, 0, 0))

side_wall_1 = Surface(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)

side_wall_2 = Surface(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)
back_wall = Surface(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)
pillar_1 = Curve(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)
pillar_2 = Curve(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)
roof = Surface(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)

# ----
# 1. Constructing the model
# The elements, supports, loads and load cases are all constructed as usual.
# For this example, we constructed a simple structure with walls on the short
# sides and on one long side, and supporting pillars on the opposite side.
merge = Merge(Data1=pillar_base_2, Data2=pillar_base_3)
merge_2 = Merge(Data1=side_wall_base_1, Data2=side_wall_base_2)

# ----
# 1.1. Building elements
merge_3 = Merge(Data1=pillar_1, Data2=pillar_2)
countrycode_d_dk_est_fin_gb_h_n_pl_ro_s = Panel("S")  # "Countrycode (D/DK/EST/FIN/GB/H/N/PL/RO/S/TR)"
materialdatabase = MaterialDatabase(CountryCode=countrycode_d_dk_est_fin_gb_h_n_pl_ro_s)  # -> SteelMaterial, ConcreteMaterial, TimberMaterial, ReinforcementMaterial, StratumMaterial, CustomMaterial
sectiondatabase = SectionDatabase()  # -> SteelSection, ConcreteSection, TimberSection, HollowCoreSection, CustomSection
merge_4 = Merge(Data1=side_wall_1, Data2=side_wall_2)
getmaterialbyname_index = MaterialGetMaterialByNameIndex(Materials=materialdatabase.ConcreteMaterial, MaterialNameIndex="C40/50")
getsectionbyname_index = SectionGetSectionByNameIndex(Sections=sectiondatabase.ConcreteSection, SectionNameIndex="Concrete sections, Circle, D 300")
unit_z = UnitZ(Factor=1)
unit_y = UnitY(Factor=1)
unit_z_2 = UnitZ(Factor=1)
unit_x = UnitX(Factor=1)
unit_x_2 = UnitX(Factor=1)
unit_z_3 = UnitZ(Factor=1)
unit_y_2 = UnitY(Factor=1)
column = BarsColumn(
    Line=merge_3,
    Material=getmaterialbyname_index,
    Section=getsectionbyname_index,
    LocalY=unit_y_2,
    OrientLCS=True,
    Identifier="C")
construct = Plate(
    Surface=roof,
    Thickness=Slider(0.2, range=0..1),
    Material=getmaterialbyname_index,
    LocalX=unit_x_2,
    LocalZ=unit_z_3,
    Identifier="Roof")
construct_2 = Plate(
    Surface=back_wall,
    Thickness=Slider(0.2, range=0..1),
    Material=getmaterialbyname_index,
    LocalX=unit_x,
    LocalZ=unit_z_2,
    Identifier="Back wall")
construct_3 = Plate(
    Surface=merge_4,
    Thickness=Slider(0.2, range=0..1),
    Material=getmaterialbyname_index,
    LocalX=unit_y,
    LocalZ=unit_z,
    Identifier="Side wall")

# ----
# 1.3. Load cases
panel = Panel("Liveload")
list = ValueList({"ordinary", "dead_load", "soil_dead_load", "shrinkage", "prestressing", "fire", "seis_sxp", "seis_sxm", "seis_syp", "seis_sym"}, selected="dead_load")
list_2 = ValueList({"ordinary", "dead_load", "soil_dead_load", "shrinkage", "prestressing", "fire", "seis_sxp", "seis_sxm", "seis_syp", "seis_sym"}, selected="ordinary")
list_3 = ValueList({"permanent", "long-term", "medium-term", "short-term", "instantaneous"}, selected="permanent")
list_4 = ValueList({"permanent", "long-term", "medium-term", "short-term", "instantaneous"}, selected="permanent")
construct_4 = LoadCaseConstruct(Name="Deadload", Type=list, DurationClass=list_3)
construct_5 = LoadCaseConstruct(Name=panel, Type=list_2, DurationClass=list_4)
merge_5 = Merge(Data1=construct_4, Data2=construct_5)

# ----
# 1.2. Supports
unit_x_3 = UnitX(Factor=1)
unit_y_3 = UnitY(Factor=1)
linesupport_hinged = LineSupportHinged(Curve=back_wall_base, MovingLocal=False, LocalY=unit_y_3, OrientLCS=True, Identifier="S")
linesupport_hinged_2 = LineSupportHinged(Curve=merge_2, MovingLocal=False, LocalY=unit_x_3, OrientLCS=True, Identifier="S")
pointsupport_hinged = PointSupportHinged(Point=merge, Identifier="S")
merge_6 = Merge(Data1=pointsupport_hinged, Data2=linesupport_hinged, Data3=linesupport_hinged_2)

# ----
# Example 3: Setup for advanced calculations
# This example will showcase how you can access some more advanced
# analysis settings, such as specific calculation models for load combinations,
# and eigenfrequency calculations for load cases.
info = Info(versionWhenCreated="23.2.0")

merge_7 = Merge(Data1=column, Data2=construct, Data3=construct_2, Data4=construct_3)

# ----
# 1.4. Loads
number_slider = Slider(2.5, range=0..20)
unit_z_4 = UnitZ(Factor=expr("-x", Slider(0.7, range=0..20)))
unit_z_5 = UnitZ(Factor=expr("-x", number_slider))
load_case_deadload = Data(construct_4)
load_case_liveload = Data(construct_5)
roof_2 = Surface(roof)
roof_3 = Surface(roof)
surfaceload_uniform = SurfaceLoadUniform(Surface=roof_3, Force=unit_z_5, LoadCase=load_case_liveload)
surfaceload_uniform_2 = SurfaceLoadUniform(Surface=roof_2, Force=unit_z_4, LoadCase=load_case_deadload)

# ----
# 1.5. Load combinations
list_5 = ValueList({"ultimate_ordinary", "ultimate_accidental", "ultimate_seismic", "serviceability_quasi_permanent", "serviceability_frequent", "serviceability_characteristic"}, selected="serviceability_characteristic")
list_6 = ValueList({"ultimate_ordinary", "ultimate_accidental", "ultimate_seismic", "serviceability_quasi_permanent", "serviceability_frequent", "serviceability_characteristic"}, selected="ultimate_ordinary")
panel_2 = Panel("""1.0
1.0""")
panel_3 = Panel("""1.35
1.5""")
construct_6 = LoadCombinationConstruct(Name="SLS", Type=list_5, LoadCase=merge_5, Gamma=panel_2)
construct_7 = LoadCombinationConstruct(Name="ULS", Type=list_6, LoadCase=merge_5, Gamma=panel_3)
merge_8 = Merge(Data1=construct_6, Data2=construct_7)

# ----
# 2. Mass conversion
# For the eigenfrequencies to be calculated, we have
# to define the mass conversion for a load case. This
# is applied using the MassConversionTable.Define
# component, and then added to the model as a load.
panel_4 = Panel("1")
massconversiontable_define = MassConversionTableDefine(LoadCase=construct_5, Factor=panel_4)

merge_9 = Merge(Data1=surfaceload_uniform, Data2=surfaceload_uniform_2, Data3=massconversiontable_define)

# ----
# 3. Creating the model
# Loads, Load cases and Load combinations all have their own
# input, while the Beam and the Supports both count as elements.
# Remember to use the same country code as before!
elements = Data(flatten([merge_6, merge_7]))
loads = Data(flatten(merge_9))
countrycode_d_dk_est_fin_gb_h_n_pl_ro_s_2 = Panel("S")  # "Countrycode (D/DK/EST/FIN/GB/H/N/PL/RO/S/TR)"
loadcases = Data(flatten(merge_5))
loadcombinations = Data(flatten(merge_8))
model_construct = ModelConstruct(
    CountryCode=countrycode_d_dk_est_fin_gb_h_n_pl_ro_s_2,
    StructureElements=elements,
    Loads=loads,
    LoadCases=loadcases,
    LoadCombinations=loadcombinations)
model = Data(model_construct)

# ----
# 5.1. Advanced calculation settings
# The Comb.Settings and Comb.Define components provide
# access to more specialized analysis settings.
loadcombination = Data(construct_7)
comb_settings = CombSettings(LoadCombination=loadcombination, NLE="true", PL=False, NLS=False, Cr=False, F2nd=False, Im=0, Amplitude=0, Waterlevel=0)
comb_define = CombDefine(
    NLEmaxiter=30,
    PLdefloadstep=20,
    PLminloadstep=2,
    PlKeepLoadStep=True,
    PlTolerance=1,
    Plmaxeqiter=50,
    PlShellLayers=10,
    NLSMohr=True,
    NLSinitloadstep=10,
    NLSminloadstep=10,
    NLSactiveelemratio=5,
    NLSplasticelemratio=5,
    CRloadstep=20,
    CRmaxiter=30,
    CRstifferror=2,
    CombSettings=comb_settings)

# ----
# 5. Analysis settings
# For this example, we'll select the basic Load Case and Load Combination calculcations,
# as well as Stability and Eigenfrequency calculations. The Stability.Define and Freq.Define
# components allow the user to define certain settings for the Stability and Eigenfrequency
# calculations.
number_slider_2 = Slider(5, range=0..10)
loadcombination_2 = Data(construct_7)
stability_define = StabilityDefine(LoadCombination=loadcombination_2, NumShapes=number_slider_2, PositiveOnly=False, NumIterations=20)
freq_define = FreqDefine(
    NumShapes=Slider(5, range=0..10),
    AutoIter=0,
    ShapeNormalisation="Unit",
    MaxSturm=0,
    X="false",
    Y="false",
    Z="true",
    Top=-0.01)
comb = Data(comb_define)
analysis_define = AnalysisDefine(
    Comb=comb,
    Stability=stability_define,
    Freq=freq_define,
    CalcCase="true",
    CalcComb="true",
    CalcCstage=False,
    CalcImpf=False,
    CalcGmax=False,
    CalcStab="true",
    CalcFreq="true",
    CalcSeis=False,
    CalcDesign=False,
    CalcFootfall=False,
    Elemfine=True,
    Diaphragm=0,
    PeakSmoothing=False)

# ----
# 4. Create a directory for your file
# You can either choose to save your file in your current directory,
# or select your own separate folder. If you'd choose the latter,
# simply rightclick the directory component and choose "select a
# directory". Finally, edit the file name panel to give your file a name.
# Remember to end it with .struxml .
use_file_path_from = ValueList({"current directory": 0, "user defined folder": 1}, selected="current directory")
user_defined_folder = FilePath("C:\Users\SamuelNyberg\OneDrive - StruSoft AB\Samuels arbetshörna\2. API-exempel\")
file_name_end_with_struxml = Panel("Example 3 - Advanced calculation model.struxml")
current_directory = GhPythonScript()  # -> folder
# ---------- current_directory: Python ----------
import rhinoscriptsyntax as rs

folder = rs.DocumentPath()
# ---------- end current_directory ----------
stream_filter = StreamFilter(Gate=use_file_path_from, Stream0=current_directory, Stream1=user_defined_folder)
concatenate = Concatenate(FragmentA=stream_filter, FragmentB=file_name_end_with_struxml)

resulting_file_path = Panel(concatenate)

# ----
# 6. Run the analysis
fem_design_connection = FEMDesignConnection(FEMDesignDir="C:\\Program Files\\StruSoft\\FEM-Design 24\\", Minimized=False, DeleteOutputFolder=False)
model_2 = Data(model)
fem_design_openmodel = FEMDesignOpenModel(Connection=fem_design_connection, Model=model_2)  # -> Connection, Model, Success, Log
analysis_settings = Data(analysis_define)
fem_design_runanalysis = FEMDesignRunAnalysis(Connection=fem_design_openmodel.Connection, Analysis=analysis_settings)  # -> Connection, Success, Log
file_path = Data(concatenate)
fem_design_save = FEMDesignSave(Connection=fem_design_runanalysis.Connection, FilePath=file_path)  # -> Connection, Success, Log
