# Grasshopper definition Example 6 - Manual and automatic RC design.gh (Grasshopper 1.0.8)
# plug-ins: FEM-Design

# ----
# Steps 5-10 of the script are familiar from earlier examples - there is not much to say about them.
# 5. Load cases
panel = Panel("Liveload")
list = ValueList({"Ordinary", "DeadLoad", "SoilDeadLoad", "Shrinkage", "Prestressing", "Fire", "Seis_sxp", "Seis_sxm", "Seis_syp", "Seis_sym", "Deviation", "Notional", "Seis_max"}, selected="Ordinary")
list_2 = ValueList({"Permanent", "LongTerm", "MediumTerm", "ShortTerm", "Instantaneous"}, selected="Permanent")
list_3 = ValueList({"Ordinary", "DeadLoad", "SoilDeadLoad", "Shrinkage", "Prestressing", "Fire", "Seis_sxp", "Seis_sxm", "Seis_syp", "Seis_sym", "Deviation", "Notional", "Seis_max"}, selected="Ordinary")
list_4 = ValueList({"Permanent", "LongTerm", "MediumTerm", "ShortTerm", "Instantaneous"}, selected="Permanent")
construct = LoadCaseConstruct(Name=panel, Type=list, DurationClass=list_2)
construct_2 = LoadCaseConstruct(Name="Deadload", Type=list_3, DurationClass=list_4)
merge = Merge(Data1=construct, Data2=construct_2)

# ----
# Geometry
support_points_beam = Point([Point(1, 2, 0), Point(4, 2, 0), Point(8, 2, 0)])
support_points_slab = Point([Point(2, 9, 0), Point(4, 9, 0), Point(6, 9, 0), Point(6, 7, 0), Point(6, 5, 0), Point(4, 5, 0), Point(2, 5, 0), Point(2, 7, 0), Point(4, 7, 0)])
# 0. Materials, sections, and geometry
# We will be using data from these a lot in the script, which could
# lead to either a lot of components or a lot of wires cluttering
# the workspace. To avoid this and make the script easier to read,
# we can gather these components in one corner, and then set all
# connected wires to invisible. However, we left a data container
# at the end of each wire, so it's clear what it's connected to.
beam_baseline = Curve(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)
slab_surface = Surface(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)

dl_longitudinal_bar_diameter_mm = Slider(6, range=6..25)

# ----
# 4.1. Variables for the plate reinforcement
# Besides the normal plate thickness, the reinforcement itself requires a
# spacing measure, a cover depth, and a diameter for the wire.
# Part 3: Loads and supports
reinforcement_net_bar_diameter_m = Slider(0.005, range=0..0.07)
reinforcement_net_spacing_m = Slider(0.15, range=0..1)
reinforcement_net_cover_m = Slider(0.02, range=0..0.1)
# Part 2: Creating a reinforced plate
# Reinforcing a plate is easier than a beam, and only requires a small amount of components.
slab_thickness_m = Slider(0.2, range=0..1)

# ----
# 3.1. Variables for the longitudinal bars
# The longidutinal bars are defined by their start and end, and the
# additional anchorage are added. Be careful to not add more
# anchorage than there is available space!
# S
# E
# SA
# EA
sa_start_anchorage_m = Slider(0.4, range=0..1)
ea_end_anchorage_m = Slider(0.4, range=0..1)
s_start_m = Slider(0, range=0..7)
# Stick out 40xdiameter ca
# and bar full length
e_end_m = Slider(7, range=0..7)
expression = Expression(x=dl_longitudinal_bar_diameter_mm, Expression="x/1000")

# ----
# 2.1. Variables for the stirrups
# The stirrups will be spaced evenly with a spacing of your choice
# within a span on the left, middle, and right parts of the bar. You
# may also choose the diameter and cover of the stirrups.
# d
# cd
# lr
# ll
# sl
# sr
# sm
cd_stirrup_cover_depth_m = Slider(0.03, range=0.001..0.2)
d_stirrup_bar_diameter_m = Slider(0.01, range=0..0.07)
sm_spacing_middle_m = Slider(0.2, range=0..1)
sr_spacing_right_m = Slider(0.1, range=0..2)
lr_length_right_m = Slider(1.2, range=0..7)
sl_spacing_left_m = Slider(0.1, range=0..1)
ll_length_left_m = Slider(1.2, range=0..7)

# ----
# Materials and sections
countrycode_d_dk_est_fin_gb_h_n_pl_ro_s = Panel("S")  # "Countrycode (D/DK/EST/FIN/GB/H/N/PL/RO/S/TR)"
materialdatabase = MaterialDatabase(CountryCode=countrycode_d_dk_est_fin_gb_h_n_pl_ro_s)  # -> SteelMaterial, ConcreteMaterial, TimberMaterial, ReinforcementMaterial, StratumMaterial, CustomMaterial
sectiondatabase = SectionDatabase()  # -> SteelSection, ConcreteSection, TimberSection, HollowCoreSection, CustomSection
getmaterialbyname_index = MaterialGetMaterialByNameIndex(Materials=materialdatabase.ConcreteMaterial, MaterialNameIndex="C35/45")
getmaterialbyname_index_2 = MaterialGetMaterialByNameIndex(Materials=materialdatabase.ReinforcementMaterial, MaterialNameIndex="K500B")
getsectionbyname_index = SectionGetSectionByNameIndex(Sections=sectiondatabase.ConcreteSection, SectionNameIndex="Concrete sections, Rectangle, 400x500")
concrete_material = Data(getmaterialbyname_index)
beam_section = Data(getsectionbyname_index)
reinforcement_material = Data(getmaterialbyname_index_2)

# ----
# 1. Creating the bar
concrete_material_2 = Data(concrete_material)
# Part 1: Creating a reinforced beam
# The reinforced beam requires quite a lot of components and variables. In return,
# this gives a great deal of freedom in the design process, letting you customize
# your reinforcement placement, spacing, anchorage, and more.
beam_baseline_2 = Curve(beam_baseline)
beam_section_2 = Data(beam_section)
beam = BarsBeam(Curve=beam_baseline_2, Material=concrete_material_2, Section=beam_section_2, OrientLCS=True, Identifier="B")

# ----
# 2.2. Creating the stirrups
# A crucial part of the stirrup creation is the profile. This surface
# (or closed curve) represent the outer boundary of the stirrup,
# so the wire diameter will go inwards from this curve.
beam_section_3 = Data(beam_section)
d_diameter = Data(d_stirrup_bar_diameter_m)
sm_spacing_middle = Data(sm_spacing_middle_m)
sr_spacing_right = Data(sr_spacing_right_m)
sl_spacing_left = Data(sl_spacing_left_m)
section_deconstruct = SectionDeconstruct(Section=beam_section_3)  # -> Guid, Name, Surfaces, SectionType, MaterialType, GroupName, TypeName, SizeName
beam_baseline_3 = Curve(beam_baseline)
brep_edges = BrepEdges(Brep=section_deconstruct.Surfaces)  # -> Naked, Interior, NonManifold
length = Length(Curve=beam_baseline_3)
lr_length_right = Number(lr_length_right_m)
join_curves = JoinCurves(Curves=brep_edges.Naked, Preserve=False)
subtraction = Subtraction(A=length, B=lr_length_right)
ll_length_left = Number(ll_length_left_m)
construct_domain = ConstructDomain(DomainStart="0", DomainEnd=ll_length_left)
construct_domain_2 = ConstructDomain(DomainStart=ll_length_left, DomainEnd=subtraction)
construct_domain_3 = ConstructDomain(DomainStart=subtraction, DomainEnd=length)
reinforcement_material_2 = Data(reinforcement_material)
merge_2 = Merge(Data1=sl_spacing_left, Data2=sm_spacing_middle, Data3=sr_spacing_right)  # -> flatten(Result)
negative = Negative(Value=cd_stirrup_cover_depth_m)
offset_curve = OffsetCurve(Curve=join_curves, Distance=negative, Plane=PlaneXY(0, 0, 0), Corners=1)
deconstruct_domain = DeconstructDomain(Domain=[construct_domain, construct_domain_2, construct_domain_3])  # -> Start, End
wire_define = WireDefine(Diameter=d_diameter, Material=reinforcement_material_2, Profile="ribbed")
stirrups = BarReinforcementStirrups(Wire=wire_define, Profile=offset_curve, Start=deconstruct_domain.Start, End=deconstruct_domain.End, Spacing=merge_2)

# ----
# 3.2. Creating the longitudinal bars
# The longitudinal bars take less special components than the stirrups,
# but the placement can be tricky. It uses an internal coordinate system
# with the crossection center as the origo, so any positioning is relative
# to that. Do also take care to not intersect the bars and the stirrup profile!
beam_section_4 = Data(beam_section)
section_deconstruct_2 = SectionDeconstruct(Section=beam_section_4)  # -> Guid, Name, Surfaces, SectionType, MaterialType, GroupName, TypeName, SizeName
longitudinal_bar_diameter_dl = Number(expression)
dimensions = Dimensions(Surface=section_deconstruct_2.Surfaces)  # -> UDimension, VDimension
stirrup_bar_diameter_ds = Number(d_stirrup_bar_diameter_m)
cover_depth_cvr = Number(cd_stirrup_cover_depth_m)
expression_2 = Expression(
    y=dimensions.UDimension,
    cvr=cover_depth_cvr,
    ds=stirrup_bar_diameter_ds,
    dl=longitudinal_bar_diameter_dl,
    Expression="y/2-cvr-ds-dl/2")
expression_3 = Expression(
    z=dimensions.VDimension,
    cvr=cover_depth_cvr,
    ds=stirrup_bar_diameter_ds,
    dl=longitudinal_bar_diameter_dl,
    Expression="z/2-cvr-ds-dl/2")
reinforcement_material_3 = Data(reinforcement_material)
d_diameter_2 = Data(expression)
wire_define_2 = WireDefine(Diameter=d_diameter_2, Material=reinforcement_material_3, Profile="ribbed")
sa_start_anchorage = Number(sa_start_anchorage_m)
negative_2 = Negative(Value=expression_2)
negative_3 = Negative(Value=expression_3)
ea_end_anchorage = Number(ea_end_anchorage_m)
s_start = Number(s_start_m)
e_end = Number(e_end_m)
longitudinalbar = BarReinforcementLongitudinalBar(
    Wire=wire_define_2,
    YPos=graft([expression_2, negative_2]),
    ZPos=[expression_3, negative_3],
    StartAnchorage=sa_start_anchorage,
    EndAnchorage=ea_end_anchorage,
    Start=s_start,
    End=e_end,
    AuxiliaryBar=False)  # -> flatten(LongitudinalBars)

# ----
# 7. Load combinations
list_5 = ValueList({"ultimate_ordinary", "ultimate_accidental", "ultimate_seismic", "serviceability_quasi_permanent", "serviceability_frequent", "serviceability_characteristic"}, selected="serviceability_characteristic")
list_6 = ValueList({"ultimate_ordinary", "ultimate_accidental", "ultimate_seismic", "serviceability_quasi_permanent", "serviceability_frequent", "serviceability_characteristic"}, selected="ultimate_ordinary")
panel_2 = Panel("""1.0
1.0""")
panel_3 = Panel("""1.35
1.5""")
construct_3 = LoadCombinationConstruct(Name="SLS", Type=list_5, LoadCase=merge, Gamma=panel_2)
construct_4 = LoadCombinationConstruct(Name="ULS", Type=list_6, LoadCase=merge, Gamma=panel_3)

# ----
# 8. Supports for beam and plate
support_points_beam_2 = Point(support_points_beam)
support_points_slab_2 = Point(support_points_slab)
motions_predefined = MotionsPredefined()  # -> Free, RigidPoint, RigidLine, RigidSurface
rotations_predefined = RotationsPredefined()  # -> Free, RigidPoint, RigidLine
pointsupport_define = PointSupportDefine(Point=support_points_slab_2, Motions=motions_predefined.RigidPoint, Rotations=rotations_predefined.Free, Identifier="S")
pointsupport_define_2 = PointSupportDefine(Point=support_points_beam_2, Motions=motions_predefined.RigidPoint, Rotations=rotations_predefined.Free, Identifier="S")

# ----
# 6. Loads
liveload_beam = Slider(10, range=0..20)
deadload_beam = Slider(20, range=0..20)
deadload_slab = Slider(20, range=0..20)
liveload_slab = Slider(10, range=0..20)
unit_z = UnitZ(Factor=liveload_beam)  # -> expr("-x", UnitVector)
unit_z_2 = UnitZ(Factor=deadload_beam)  # -> expr("-x", UnitVector)
unit_z_3 = UnitZ(Factor=liveload_slab)  # -> expr("-x", UnitVector)
unit_z_4 = UnitZ(Factor=deadload_slab)  # -> expr("-x", UnitVector)
load_case_deadload = Data(construct_2)
load_case_deadload_2 = Data(construct_2)
load_case_liveload = Data(construct)
load_case_liveload_2 = Data(construct)
beam_baseline_4 = Curve(beam_baseline)
slab_surface_2 = Surface(slab_surface)
surfaceload_uniform = SurfaceLoadUniform(Surface=slab_surface_2, Force=unit_z_3, LoadCase=load_case_liveload_2)
surfaceload_uniform_2 = SurfaceLoadUniform(Surface=slab_surface_2, Force=unit_z_4, LoadCase=load_case_deadload_2)
lineload_define = LineLoadDefine(
    Curve=beam_baseline_4,
    StartForce=unit_z,
    EndForce=unit_z,
    LoadCase=load_case_liveload,
    ConstLoadDir=True,
    LoadProjection=False,
    Type="Force")
lineload_define_2 = LineLoadDefine(
    Curve=beam_baseline_4,
    StartForce=unit_z_2,
    EndForce=unit_z_2,
    LoadCase=load_case_deadload,
    ConstLoadDir=True,
    LoadProjection=False,
    Type="Force")

# ----
# Example 6: Manual and automatic RC design
# This example will showcase how to manually create reinforced concrete
# elements - a beam and a slab - through the FEM-Design API. It will also
# show how you can use these manually created elements as a basis for the
# Autodesign function, letting FEM-Design run calculations on the structure
# and suggest an improved reinforcement design.
info = Info(versionWhenCreated="23.2.0")

merge_3 = Merge(Data1=pointsupport_define, Data2=pointsupport_define_2)
merge_4 = Merge(Data1=construct_3, Data2=construct_4)
panel_4 = Panel("Separate a bit")
merge_5 = Merge(Data1=lineload_define, Data2=lineload_define_2, Data3=surfaceload_uniform, Data4=surfaceload_uniform_2)

# ----
# 4. Add reinforcement to the bar
# With all reinforcement done, the only thing left is to apply it
# to the beam using the Bars.Deconstruct.Modify component.
deconstruct_modify = BarsDeconstructModify(Bar=beam, Stirrups=stirrups, LongitudinalBars=longitudinalbar)  # -> Bar, Guid, Curve, Material, Section, Connectivity, Eccentricity, LocalY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

# ----
# 10. Select a directory for your file
# Choose either to place the .struxml file in the current
# directory, or manually select a particular folder.
would_you_like_to_place_your_file_in = ValueList({"current directory": 0, "user define folder": 1}, selected="user define folder")  # disabled
right_click_to_define_folder = FilePath("C:\Users\LőrinczAndrea\Desktop\")  # disabled
current_directory = GhPythonScript()  # -> folder; disabled
# ---------- current_directory: Python ----------
import rhinoscriptsyntax as rs

folder = rs.DocumentPath()
# ---------- end current_directory ----------
stream_filter = StreamFilter(Gate=would_you_like_to_place_your_file_in, Stream0=current_directory, Stream1=right_click_to_define_folder)  # disabled

value_list = ValueList({"rc", "steel", "timber"}, selected="rc")
boolean_toggle = BooleanToggle(True)
design_define = DesignDefine(Mode=value_list, AutoDesign=boolean_toggle, Check=boolean_toggle, BasedOn=True, ApplyChanges=False)

# ----
# 4.2 Creating the reinforced plate
# The reinforcement net is defined as wires placed in the X and Y direction,
# at the top or the bottom of the plate. If you wanted, you could also place a
# net in the middle of the slab, vary wire thickness or spacing, etc.
wire_direction = Panel("""x
y""")
slab_face = Panel("""top
bottom""")
reinforcement_material_4 = Data(reinforcement_material)
straight_reinforcementlayout = StraightReinforcementLayout(Direction=wire_direction, Space=reinforcement_net_spacing_m, Face=graft(slab_face), Cover=reinforcement_net_cover_m)
wire_define_3 = WireDefine(Diameter=reinforcement_net_bar_diameter_m, Material=reinforcement_material_4, Profile="ribbed")
concrete_material_3 = Data(concrete_material)
slab_surface_3 = Surface(slab_surface)
surfacereinforcement_bysurface = SurfaceReinforcementBySurface(Surface=slab_surface_3, Straight=straight_reinforcementlayout, Wire=wire_define_3)  # -> flatten(SurfaceReinforcement)

construct_5 = Plate(Surface=slab_surface_3, Thickness=slab_thickness_m, Material=concrete_material_3, Identifier="P")

addtoslab = SurfaceReinforcementAddToSlab(Slab=construct_5, SurfaceReinforcement=surfacereinforcement_bysurface)

# ----
# 9. Creating model
reinforced_beam = Data(flatten(deconstruct_modify.Bar))  # disabled
countrycode_d_dk_est_fin_gb_h_n_pl_ro_s_2 = Panel("S")  # "Countrycode (D/DK/EST/FIN/GB/H/N/PL/RO/S/TR)"; disabled
reinforced_plate = Data(addtoslab)  # disabled
supports = Data(merge_3)  # disabled
loads = Data(merge_5)  # disabled
load_cases = Data(merge)  # disabled
load_combinations = Data(merge_4)  # disabled
model_construct = ModelConstruct(
    CountryCode=countrycode_d_dk_est_fin_gb_h_n_pl_ro_s_2,
    StructureElements=flatten([reinforced_beam, reinforced_plate, supports]),
    Loads=loads,
    LoadCases=load_cases,
    LoadCombinations=load_combinations)  # disabled

# ----
# Part 4: Manual design versus autodesign
# Once you have created the model, the manual design is done - all that's left
# is opening it in FEM-Design. However, you can also run an Autodesign to let
# FEM-Design do further calculations, using this model as a base to improve
# the design, given the applied loads.
# 11a. Show the manual design in FEM-Design...
fem_design_connection = FEMDesignConnection(Verbosity="ScriptLogLinesOnly", DeleteOutputFolder=False)  # disabled
button = Button()  # disabled
fem_design_openmodel = FEMDesignOpenModel(Connection=fem_design_connection, Model=model_construct, RunNode=button)  # -> Connection, Model, Success; disabled
file_name_end_with_struxml = Panel("manually_designed_RC.struxml")  # disabled
concatenate = Concatenate(FragmentA=stream_filter, FragmentB=file_name_end_with_struxml)  # disabled
file_path = Data(concatenate)  # disabled
fem_design_save = FEMDesignSave(Connection=fem_design_openmodel.Connection, FilePath=file_path, RunNode=True)  # -> Connection, Success; disabled
resulting_file_path = Panel(file_path)  # disabled

# ----
# 11b. ...or use it as a basis for the Autodesign
# To run an autodesign, simply use the Application.RunDesign component instead
# of the Application.RunAnalysis one. The analysis settings are still input, but you
# also need a Design.Define component, to activate the Autodesign funcion.
toggle = BooleanToggle(True)
analysis_define = AnalysisDefine(CalcCase=toggle, CalcComb=toggle, CalcGmax=False, CalcDesign=toggle, Elemfine=True, Diaphragm=0, PeakSmoothing=False)
fem_design_connection_2 = FEMDesignConnection(FEMDesignDir="C:\\Program Files\\StruSoft\\FEM-Design 24\\", Minimized=False, DeleteOutputFolder=False)  # disabled
fem_design_openmodel_2 = FEMDesignOpenModel(Connection=fem_design_connection_2, Model=model_construct)  # -> Connection, Model, Success, Log
fem_design_runanalysis = FEMDesignRunAnalysis(Connection=fem_design_openmodel_2.Connection, Analysis=analysis_define)  # -> Connection, Success, Log
fem_design_rundesign = FEMDesignRunDesign(Connection=fem_design_runanalysis.Connection, Design=design_define)  # -> Connection, Success, Log
