# Grasshopper definition Practical example - Iterative analysis.gh (Grasshopper 1.0.8)
# plug-ins: FEM-Design

number_slider = Slider(0.994, range=0..1)
crv = Curve([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])
item = ListItem(List=crv, Index=0, Wrap=True)  # -> Item, Item1

# ---- group: LoadSnippet
value_list = ValueList({"Ordinary", "DeadLoad", "SoilDeadLoad", "Shrinkage", "Prestressing", "Fire", "Seis_sxp", "Seis_sxm", "Seis_syp", "Seis_sym", "Deviation", "Notional", "Seis_max"}, selected="Ordinary")
value_list_2 = ValueList({"Permanent", "LongTerm", "MediumTerm", "ShortTerm", "Instantaneous"}, selected="Permanent")
value_list_3 = ValueList({"Ordinary", "DeadLoad", "SoilDeadLoad", "Shrinkage", "Prestressing", "Fire", "Seis_sxp", "Seis_sxm", "Seis_syp", "Seis_sym", "Deviation", "Notional", "Seis_max"}, selected="Ordinary")
value_list_4 = ValueList({"Permanent", "LongTerm", "MediumTerm", "ShortTerm", "Instantaneous"}, selected="Permanent")
loadcase_construct = LoadCaseConstruct(Name="LL", Type=value_list, DurationClass=value_list_2)
loadcase_construct_2 = LoadCaseConstruct(Name="DL", Type=value_list_3, DurationClass=value_list_4)
value_list_5 = ValueList({"ultimate_ordinary", "ultimate_accidental", "ultimate_seismic", "serviceability_quasi_permanent", "serviceability_frequent", "serviceability_characteristic"}, selected="ultimate_ordinary")
merge = Merge(Data1=loadcase_construct_2, Data2=loadcase_construct)
panel = Panel("""1.35
1.5""")
Z = UnitZ(Factor="-10.00")
loadcombination_construct = LoadCombinationConstruct(Name="ULS_DL", Type=value_list_5, LoadCase=merge, Gamma=panel)  # -> flatten(LoadCombination)
lineload_define = LineLoadDefine(Curve=item.Item1, StartForce=Z, LoadCase=loadcase_construct, ConstLoadDir=True, LoadProjection=False, Type="Force")
loadcombinations = Data(loadcombination_construct)
loadcases = Data([loadcase_construct_2, loadcase_construct])

# ----
materialdatabase = MaterialDatabase(CountryCode="S")  # -> SteelMaterial, ConcreteMaterial, TimberMaterial, ReinforcementMaterial, StratumMaterial, CustomMaterial
sectiondatabase = SectionDatabase()  # -> SteelSection, ConcreteSection, TimberSection, HollowCoreSection, CustomSection
panel_2 = Panel("""0.00
1.00""")
join = JoinCurves(Curves=crv, Preserve=False)
item_2 = ListItem(List=materialdatabase.SteelMaterial, Index=0, Wrap=True)
hframe = HorizontalFrame(Curve=reparameterize(join), Parameter=panel_2)
item_3 = ListItem(List=sectiondatabase.SteelSection, Index="10", Wrap=True)
hframe_2 = HorizontalFrame(Curve=reparameterize(join), Parameter=number_slider)
rigid = PointSupportRigid(PointPlane=hframe, Identifier="S")
hinged = PointSupportHinged(PointPlane=hframe_2, Identifier="S")
beam = BarsBeam(Curve=crv, Material=item_2, Section=item_3, OrientLCS=True, Identifier="B")
model_construct = ModelConstruct(
    CountryCode="S",
    StructureElements=[rigid, hinged, beam],
    Loads=lineload_define,
    LoadCases=loadcases,
    LoadCombinations=loadcombinations)
fem_design_connection = FEMDesignConnection(FEMDesignDir="C:\\Program Files\\StruSoft\\FEM-Design 24\\", Minimized=False, DeleteOutputFolder=False)
analysis_define = AnalysisDefine(CalcCase=True, CalcComb=True, CalcGmax=False, CalcDesign=False, Elemfine=True, Diaphragm=0, PeakSmoothing=False)
fem_design_openmodel = FEMDesignOpenModel(Connection=fem_design_connection, Model=model_construct)  # -> Connection, Model, Success, Log
resultstype = ResultsType({"NodalDisplacement", "NodalDisplacement", "PointSupportReaction", "PointSupportReactionMinMax", "PointConnectionForce", "BarDisplacement", "BarInternalForce", "BarStress", "LineSupportReaction", "LineConnectionResultant"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}, selected="NodalDisplacement")
resultstype_2 = ResultsType({"NodalDisplacement", "NodalDisplacement", "PointSupportReaction", "PointSupportReactionMinMax", "PointConnectionForce", "BarDisplacement", "BarInternalForce", "BarStress", "LineSupportReaction", "LineConnectionResultant"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}, selected="PointSupportReaction")
fem_design_runanalysis = FEMDesignRunAnalysis(Connection=fem_design_openmodel.Connection, Analysis=analysis_define)  # -> Connection, Success, Log
merge_2 = Merge(Data1=resultstype, Data2=resultstype_2)
fem_design_getcasecombresults = FEMDesignGetCaseCombResults(Connection=fem_design_runanalysis.Connection, ResultType=merge_2)  # -> Connection, Results, Success, Log
bang = ExplodeTree(Data=fem_design_getcasecombresults.Results)  # -> Branch0, Branch1
nodaldisplacement = NodalDisplacement(Result=bang.Branch0, CaseCombinationName="ULS_DL")  # -> CaseIdentifier, ElementId, NodeId, Translation, Rotation
galapagos = Galapagos(fitness=num, gene=number_slider)
vlen = VectorLength(Vector=nodaldisplacement.Translation)
sort = SortList(Keys=vlen, ValuesA=vlen)  # -> Keys, ValuesA
item_4 = ListItem(List=reverse(sort.Keys), Index=0, Wrap=True)
num = Number(item_4)
