# Grasshopper definition Practical example - Quantity estimation.gh (Grasshopper 1.0.8)
# plug-ins: FEM-Design

# ----
# Choose results
resultstype = ResultsType({"NodalDisplacement", "BarDisplacement", "BarStress", "BarInternalForce", "BarEndForce", "PointSupportReaction", "PointSupportReactionMinMax", "LineSupportReaction", "LineSupportResultant", "SurfaceSupportReaction"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}, selected="QuantityEstimationConcrete")
resultstype_2 = ResultsType({"NodalDisplacement", "BarDisplacement", "BarStress", "BarInternalForce", "BarEndForce", "PointSupportReaction", "PointSupportReactionMinMax", "LineSupportReaction", "LineSupportResultant", "SurfaceSupportReaction"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}, selected="QuantityEstimationReinforcement")
resultstype_3 = ResultsType({"NodalDisplacement", "BarDisplacement", "BarStress", "BarInternalForce", "BarEndForce", "PointSupportReaction", "PointSupportReactionMinMax", "LineSupportReaction", "LineSupportResultant", "SurfaceSupportReaction"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}, selected="QuantityEstimationSteel")
resultstype_4 = ResultsType({"NodalDisplacement", "BarDisplacement", "BarStress", "BarInternalForce", "BarEndForce", "PointSupportReaction", "PointSupportReactionMinMax", "LineSupportReaction", "LineSupportResultant", "SurfaceSupportReaction"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}, selected="QuantityEstimationTimber")
resultstype_5 = ResultsType({"NodalDisplacement", "BarDisplacement", "BarStress", "BarInternalForce", "BarEndForce", "PointSupportReaction", "PointSupportReactionMinMax", "LineSupportReaction", "LineSupportResultant", "SurfaceSupportReaction"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}, selected="QuantityEstimationProfiledPlate")
resultstype_6 = ResultsType({"NodalDisplacement", "BarDisplacement", "BarStress", "BarInternalForce", "BarEndForce", "PointSupportReaction", "PointSupportReactionMinMax", "LineSupportReaction", "LineSupportResultant", "SurfaceSupportReaction"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}, selected="QuantityEstimationMasonry")
resultstype_7 = ResultsType({"NodalDisplacement", "BarDisplacement", "BarStress", "BarInternalForce", "BarEndForce", "PointSupportReaction", "PointSupportReactionMinMax", "LineSupportReaction", "LineSupportResultant", "SurfaceSupportReaction"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}, selected="QuantityEstimationGeneral")

info = Info(versionWhenCreated="23.2.0")

# ----
# Choose units
list = ValueList({"kg", "t", "lb", "tonUK", "tonUS"}, selected="t")
units = Units(Length="m", Angle="rad", SectionalData="m", Force="kN", Mass=list, Displacement="m", Stress="Pa")

# ---- group: This may be a FEM-Design .str or .struxml file
# Practical example - Quantity estimation
# Choose file
filepath = FilePath()

# ----
merge = Merge(
    Data1=resultstype,
    Data2=resultstype_2,
    Data3=resultstype_3,
    Data4=resultstype_4,
    Data5=resultstype_5,
    Data6=resultstype_6,
    Data7=resultstype_7)

fem_design_connection = FEMDesignConnection(Verbosity="ScriptLogLinesOnly", DeleteOutputFolder=False)
fem_design_openmodel = FEMDesignOpenModel(Connection=fem_design_connection, Model=filepath, RunNode=Toggle(True))  # -> Connection, Model, Success
fem_design_getcasecombresults = FEMDesignGetCaseCombResults(Connection=fem_design_openmodel.Connection, ResultType=merge, RunNode=True)  # -> Connection, Results, Success
bang = ExplodeTree(Data=fem_design_getcasecombresults.Results)  # -> Branch0, Branch1

# ----
# Add the result deconstructors you need
generalquantityestimation = GeneralQuantityEstimation()  # -> Storey, Structure, Id, Quality, Section, UnitWeight, SubTotal, TotalWeight, PaintedArea, CO2Footprint
timberquantityestimation = TimberQuantityEstimation()  # -> Storey, Structure, Id, Quality, Section, UnitWeight, Subtotal, TotalWeight, PaintedArea, CO2Footprint
steelquantityestimation = SteelQuantityEstimation()  # -> Storey, Structure, Id, Quality, Section, UnitWeight, Subtotal, TotalWeight, PaintedArea, CO2Footprint
reinforcementquantityestimation = ReinforcementQuantityEstimation()  # -> Storey, Structure, Id, Quality, Diameter, TotalWeight, CO2Footprint

# ----
# Summarize quantities
concretequantityestimation = ConcreteQuantityEstimation(Result=bang.Branch0)  # -> Storey, Structure, Id, Quality, Section, Subtotal, Volume, TotalWeight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
timberpanelquantityestimation = TimberPanelQuantityEstimation(Result=bang.Branch1)  # -> Storey, Structure, Quality, Id, PanelType, Thickness, Length, Width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
ma = MassAddition(Input=concretequantityestimation.TotalWeight)  # -> Result, PartialResults
ma_2 = MassAddition(Input=timberpanelquantityestimation.TotalWeight)  # -> Result, PartialResults
format = Format(Format="Concrete: {0:0.0}{1}", Culture=127, Data0=ma.Result, Data1=list)
format_2 = Format(Format="Timber panels: {0:0.0}{1}", Culture=127, Data0=ma_2.Result, Data1=list)
panel = Panel(format)
panel_2 = Panel(format_2)
