# Grasshopper definition Example 3 - Advanced load combination calculations.gh (Grasshopper 1.0.7)
# plug-ins: FemDesign.Grasshopper

billar_base_2 = Point(Point(7, 0, 0))
pillar_base_3 = Point(Point(14, 0, 0))
pillar_base_4 = Point(Point(21, 0, 0))
# Example 3: Advanced load combination calculations
# This example isn't quite done yet - we'll be back!
# Lägg till två väggar
# Base geometry
pillar_base_1 = Point(Point(0, 0, 0))
wall_base = Curve(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)

pillar_1 = Curve(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)
pillar_2 = Curve(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)
pillar_3 = Curve(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)
pillar_4 = Curve(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)
roof = Surface(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)
wall = Surface(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)

# ----
# 1.1. Building elements
countrycode_d_dk_est_fin_gb_h_n_pl_ro_s = Panel("S")  # "Countrycode (D/DK/EST/FIN/GB/H/N/PL/RO/S/TR)"
merge = Merge(Data1=pillar_1, Data2=pillar_2, Data3=pillar_3, Data4=pillar_4)
materialdatabase_default = MaterialDatabaseDefault(CountryCode=countrycode_d_dk_est_fin_gb_h_n_pl_ro_s)
sectiondatabase_default = SectionDatabaseDefault()
number_slider = Slider(0.2, range=0..1)
material_getmaterialbyname = MaterialGetMaterialByName(MaterialDatabase=materialdatabase_default, MaterialName="C40/50")
section_getsectionbyname = SectionGetSectionByName(SectionDatabase=sectiondatabase_default, SectionName="Concrete sections, Circle, D 250")
unit_z = UnitZ(Factor=1)
unit_x = UnitX(Factor=1)
unit_y = UnitY(Factor=1)
slab_plate = SlabPlate(
    Surface=roof,
    Thickness=number_slider,
    Material=material_getmaterialbyname,
    LocalX=unit_x,
    LocalZ=unit_z,
    Identifier="Roof")
bars_column = BarsColumn(
    Line=merge,
    Material=material_getmaterialbyname,
    Section=section_getsectionbyname,
    LocalY=unit_y,
    OrientLCS=True,
    Identifier="C")
slab_wall = SlabWall(
    Surface=wall,
    Thickness=number_slider,
    Material=material_getmaterialbyname,
    LocalX=unit_x,
    LocalZ=unit_z,
    Identifier="Wall")

# ----
# 1. Constructing the model
# The elements, supports, loads and load cases are all constructed as usual.
# For this example, we constructed a simple structure with a wall on one side,
# four pillars on the other, and a roof to cover it all.
merge_2 = Merge(Data1=pillar_base_1, Data2=billar_base_2, Data3=pillar_base_3, Data4=pillar_base_4)

# ----
# 1.3. Load cases
panel = Panel("Liveload")
loadcase_create = LoadCaseCreate(Name=panel, Type="static", DurationClass="permanent")
loadcase_create_2 = LoadCaseCreate(Name="Deadload", Type="dead_load", DurationClass="permanent")
merge_3 = Merge(Data1=loadcase_create, Data2=loadcase_create_2)

# ----
# 2.1. Load combinations
panel_2 = Panel("serviceability_characteristic")
panel_3 = Panel("""1.35
1.5""")
panel_4 = Panel("""1.0
1.0""")
# 2. Settings for the load combinations
# Using the LoadCombination.SetupCalculation component, you gain access to more specialised settings,
# letting you calculate for Non-Linear Elasticity, Plastic behaviour, Second order behavour, and more.
panel_5 = Panel("SLS")
loadcombination_create = LoadCombinationCreate(Name=panel_5, Type=panel_2, LoadCase=merge_3, Gamma=panel_4)
loadcombination_create_2 = LoadCombinationCreate(Name="ULS", Type="ultimate_ordinary", LoadCase=merge_3, Gamma=panel_3)

merge_4 = Merge(Data1=bars_column, Data2=slab_plate, Data3=slab_wall)
info = Info()

# ----
# 1.2. Supports
unit_y_2 = UnitY(Factor=1)
linesupport_hinged = LineSupportHinged(Curve=wall_base, MovingLocal=False, LocalY=unit_y_2, OrientLCS=True, Identifier="S")
pointsupport_hinged = PointSupportHinged(Point=merge_2, Identifier="S")
merge_5 = Merge(Data1=pointsupport_hinged, Data2=linesupport_hinged)

# ----
# 1.4. Loads
number_slider_2 = Slider(10, range=0..20)
unit_z_2 = UnitZ(Factor=expr("-x", number_slider_2))
load_case_liveload = Data(loadcase_create)
roof_2 = Surface(roof)
surfaceload_uniform = SurfaceLoadUniform(Surface=roof_2, Force=unit_z_2, LoadCase=load_case_liveload)

# ----
# 2.2. Advanced settings
panel_6 = Panel("true")
# 1) Vilka inställningar ska vi köra i programmet?
# 2) Något mer som ska med, eller är det bara här det händer?
panel_7 = Panel("true")
loadcombination_setupcalculation = LoadCombinationSetupCalculation(
    LoadCombination=loadcombination_create_2,
    ImpfRqd=0,
    StabRqd=0,
    NLE=panel_7,
    PL=False,
    NLS=False,
    Cr=False,
    F2nd=panel_7,
    Im=False,
    Waterlevel=0)
loadcombination_setupcalculation_2 = LoadCombinationSetupCalculation(
    LoadCombination=loadcombination_create,
    ImpfRqd=0,
    StabRqd=0,
    NLE=panel_6,
    PL=False,
    NLS=False,
    Cr=False,
    F2nd=panel_6,
    Im=False,
    Waterlevel=0)
merge_6 = Merge(Data1=loadcombination_setupcalculation_2, Data2=loadcombination_setupcalculation)

# ----
# 4. Analysis settings
# Select the analyses you want to run using
# a simple "true" statement. These settings
# are the same as the ones you'd see if you
# ran the analysis in the FEM-Design interface.
comb_define = CombDefine(
    NLEmaxiter=30,
    PLdefloadstep=20,
    PLminloadstep=2,
    Plmaxeqiter=30,
    NLSMohr=True,
    NLSinitloadstep=10,
    NLSminloadstep=10,
    NLSactiveelemratio=5,
    NLSplasticelemratio=5,
    CRloadstep=20,
    CRmaxiter=30,
    CRstifferror=2)

load_cases = Data(merge_3)
load_combinations = Data(merge_6)
loads = Data(surfaceload_uniform)
structure_elements = Data(merge_4)
# 3. Creating the model
# Loads, Load cases and Load combinations all have their own
# input, while the Beam and the Supports both count as elements.
# Remember to use the same country code as before!
countrycode_d_dk_est_fin_gb_h_n_pl_ro_s_2 = Panel("S")  # "Countrycode (D/DK/EST/FIN/GB/H/N/PL/RO/S/TR)"
supports = Data(merge_5)
model_createsimple = ModelCreateSimple(
    CountryCode=countrycode_d_dk_est_fin_gb_h_n_pl_ro_s_2,
    StructureElements=[supports, structure_elements],
    Loads=loads,
    LoadCases=load_cases,
    LoadCombinations=load_combinations)

# ----
# 1) Vilka analyser ska vi köra i programmet?
# 2) Något mer som ska in här? Ska jag använda komponenten ovan?
panel_8 = Panel("true")
analysis_define = AnalysisDefine(
    Comb=comb_define,
    CalcCase=panel_8,
    CalcCstage=False,
    CalcImpf=False,
    CalcComb=panel_8,
    CalcGmax=False,
    CalcStab=False,
    CalcFreq=False,
    CalcSeis=False,
    CalcDesign=False,
    CalcFootfall=False,
    Elemfine=False,
    Diaphragm=False,
    PeakSmoothing=False)

file_name_end_with_struxml = Panel("analyse_example_model.struxml")
press_to_open_model_in_fem_design_and_ru = Button()  # "Press to open model in FEM-Design and run analysis:"
close_all_open_fem_design_windows_when_r = BooleanToggle(True)  # "Close all open FEM-Design windows when running?"
close_fem_design_window_after_analysis_i = BooleanToggle(False)  # "Close FEM-Design window after analysis is done?"
# 5. Run the analysis
# When you active the analysis component, it immediately opens FEM-Design
# and runs the analysis automatically. You can choose to leave the window open,
# or have it close when the analysis is complete.
# 
# Before you run the analysis, remember to give a proper file path. Rightclick
# the directory component and choose "select a directory", then edit the file name
# panel to give your file a name. Remember to end it with .struxml !
directory = FilePath("C:\Users\SamuelNyberg\OneDrive - StruSoft AB\Samuels arbetshörna\2. API-exempel\")
concatenate = Concatenate(FragmentA=directory, FragmentB=file_name_end_with_struxml)
resulting_file_path = Panel(concatenate)
analysis_settings = Data(analysis_define)
model = Data(model_createsimple)
application_runanalysis = ApplicationRunAnalysis(
    FdModel=model,
    FilePathStruxml=concatenate,
    Analysis=analysis_settings,
    EndSession=close_fem_design_window_after_analysis_i,
    CloseOpenWindows=close_all_open_fem_design_windows_when_r,
    RunNode=press_to_open_model_in_fem_design_and_ru)
